# Grasshopper definition back.gh (Grasshopper 1.0.7)

point = Point(<point referenced from the Rhino model>)
curve = Curve(<curve referenced from the Rhino model>)
c_script = CSharpScript(curve=curve, targetPoint=point)  # -> out, A; inputs curve: Curve, targetPoint: Point3d
# ---------- c_script: C# ----------
    // 获取曲线的中点
    // 获取曲线的中点
    double t;
    curve.LengthParameter(curve.GetLength() / 2, out t);
    Point3d midPoint = curve.PointAt(t);

    // 创建向量
    Vector3d vector = targetPoint - midPoint;

    // 获取曲线在中点的切线向量
    Vector3d tangent = curve.TangentAt(t);

    // 计算垂直于切线向量、且大致指向目标点的向量
    Vector3d perpVector = Vector3d.CrossProduct(tangent, Vector3d.ZAxis);
    if (Vector3d.VectorAngle(perpVector, vector) > Math.PI / 2)
    {
      perpVector = -perpVector;
    }

    // 创建线段
    Line perpLine = new Line(midPoint, midPoint + perpVector);

    A = perpLine;
# ---------- end c_script ----------
