# Grasshopper definition main-8-7.gh (Grasshopper 1.0.7)
# plug-ins: TianParameterModelForOpt, Human, Wallacei

panel = Panel("""1
1
1
0.5
0.01
0.64
0.69""")

# ---- group: Base line
# 01-subdivision base
geometry_pipeline = GeometryPipeline(
    GroupByLayer=False,
    GroupByType=False,
    IncludeHidden=True,
    IncludeLocked=True,
    LayerFilter="boundary",
    NameFilter="*",
    SublayerFiltering=True,
    TypeFilter=4)
geometry_pipeline_2 = GeometryPipeline(
    GroupByLayer=False,
    GroupByType=False,
    IncludeHidden=True,
    IncludeLocked=True,
    LayerFilter="boundary_back",
    NameFilter="*",
    SublayerFiltering=True,
    TypeFilter=4)
project = Project(Geometry=geometry_pipeline, Plane=PlaneXY(0, 0, 0))  # -> Geometry, Transform

# ---- group: Split direction
wlc_split_direction = GenePool(Decimals=0, Maximum=1, Minimum=0, Value=[1, 1, 0, 1, 0, 1, 0])
split_direction = Panel(wlc_split_direction)

# ----
graft_tree = GraftTree(Tree=panel, IncludeEmptyLists=True, IncludeNullItems=True)

# ---- group: Split degree
wlc_split_degree = GenePool(Decimals=6, Maximum=1, Minimum=0, Value=[0.766546, 0.807459, 0.602533, 0.986112, 0.140849, 0.3978, 0.798715])
split_degree = Panel(wlc_split_degree)

# ---- group: Floors num
wlc_floors_num = GenePool(Decimals=0, Maximum=6, Minimum=4, Value=[6, 5, 5, 5, 6, 6, 5, 5])
floors_number = Panel(wlc_floors_num)

# ---- group: Subdivision base
split_base = GhPythonScript(
    project_base=project.Geometry,
    split_direction=wlc_split_direction,
    split_degree=wlc_split_degree,
    setback="-5",
    rotate_angle=Slider(72, range=0..100))  # -> out, splited_space, setbacked_base; inputs project_base: Curve, split_direction: list of Int32, split_degree: list
# ---------- split_base: Python ----------
# coding=utf-8
"""
                       _oo0oo_
                      o8888888o
                      88" . "88
                      (| -_- |)
                      0\  =  /0
                    ___/`---'\___
                  .' \\|     |// '.
                 / \\|||  :  |||// \
                / _||||| -:- |||||- \
               |   | \\\  - /// |   |
               | \_|  ''\---/''  |_/ |
               \  .-\__  '-'  ___/-. /
             ___'. .'  /--.--\  `. .'___
          ."" '<  `.___\_<|>_/___.' >' "".
         | | :  `- \`.;`\ _ /`;.`/ - ` : | |
         \  \ `_.   \_ __\ /__ _/   .-` /  /
     =====`-.____`.___ \_____/___.-`___.-'=====
                       `=---='


     ~~~~~~~~~~~~~~~~~~~~~~~~~~~~~~~~~~~~~~~~~~~

           佛祖保佑       永不宕机     永无BUG
"""

import Rhino.Geometry as rh
from scriptcontext import doc
import rhinoscriptsyntax as rs

ds = _split_direction
ss = _split_degree
#curve = _project_base

tol = doc.ModelAbsoluteTolerance

## setback the base
base_polyline = rh.PolylineCurve.ToPolyline(rh.Curve.ToPolyline(_project_base, tol, tol, 1000, 1000))
centpt = rh.Polyline.CenterPoint(base_polyline)
XYplane = rh.Plane(centpt, rs.coerce3dvector([0, 0, 1]))

condition = rh.CurveOffsetCornerStyle.Sharp
array_setback = rh.Curve.Offset(_project_base, XYplane, _setback, tol, condition)

if len(array_setback) > 1:
    jointed_setback = rh.Curve.JoinCurves(array_setback)
else:
    jointed_setback = array_setback

curve = jointed_setback[0]

## function to split one curve by direction (d) and split (s) parameter

def rotate_bounding_box(base, bounding, angle):
    ## Not be used
    
    centpt = rh.AreaMassProperties.Compute(_project_base).Centroid
    scale = rh.Transform.Scale(rh.Plane.WorldXY, 5, 5, 1)
    rotate = rh.Transform.Rotation(angle, rh.Plane.WorldXY.ZAxis, centpt)
    
    bounding.Transform(scale)
    bounding.Transform(rotate)
    
    return bounding

def split_curve(curve, d, s):
    #    bb = rh.Curve.GetBoundingBox(
    
    bb = curve.GetBoundingBox(True)
#    bbo = curve.GetBoundingBox(True)
#    bb = rotate_bounding_box(curve, bbo, _rotate_angle)
    
    base_pt = rh.Point3d(bb.Min.X, bb.Min.Y, 0.0)
    
    x = bb.Max.X - bb.Min.X
    y = bb.Max.Y - bb.Min.Y
#    print(x, y)
    dims = [x, y]
    vecs = [rh.Vector3d(1,0,0), rh.Vector3d(0,1,0)]
    
    vec_1 = vecs[d] * dims[d] * s
    new_pt_1 = rh.Point3d(base_pt)
    new_pt_1.Transform(rh.Transform.Translation(vec_1))
    
    other_dir = abs(d - 1)
    
    vec_2 = vecs[other_dir] * dims[other_dir]
    new_pt_2 = rh.Point3d(new_pt_1)
    new_pt_2.Transform(rh.Transform.Translation(vec_2))
    
    
    split_line = rh.Line(new_pt_1, new_pt_2).ToNurbsCurve()
    
    inter = rh.Intersect.Intersection.CurveCurve(curve, split_line, tol, tol)
    p = [i.ParameterA for i in inter]
    
    if len(p) > 2:
        for i in range(len(p)):
            
            pt1 = curve.PointAt(p[i-1])
            pt2 = curve.PointAt(p[i])
            
            line = rh.Line(pt1, pt2).ToNurbsCurve()
            cp = line.PointAtNormalizedLength(0.5)
            
            if (curve.Contains(cp) == rh.PointContainment.Inside and 
                    len(rh.Intersect.Intersection.CurveCurve(curve, line, tol, tol)) <= 2):
                p = [p[i-1], p[i]]
                break
    
    pieces = curve.Split(p)
    
    curves = []
    
    for piece in pieces:
        line = rh.Line(piece.PointAtStart, piece.PointAtEnd)
        curve = rh.NurbsCurve.JoinCurves([piece, line.ToNurbsCurve()])
        curves += curve
    
    return curves


def split_recursively(curves, ds, ss):
    
    if len(ds) == 0 or len(ss) == 0:
        return curves
    
    curve = curves.pop(0)
    d = ds.pop(0)
    s = ss.pop(0)
    
    curves += split_curve(curve, d, s)
    
    print(len(curves))
    
    return split_recursively(curves, ds, ss)
print(curve)
print(ds)
print(ss)

splited_space_ = split_recursively([curve], ds, ss)
setbacked_base_ = curve
# ---------- end split_base ----------
north_south_zones = GhPythonScript(base=project.Geometry)  # -> a; inputs base: Curve
# ---------- north_south_zones: Python ----------
import Rhino.Geometry as rg

def generate_rectangles(base, offset=10.0):
    # 找到多边形的纵向分割线
    bbox = base.GetBoundingBox(True)
    center = bbox.Center
    start = rg.Point3d(bbox.Min.X, center.Y, 0)
    end = rg.Point3d(bbox.Max.X, center.Y, 0)

    # 将分割线延长到可包裹多边形的纵向长度
    diagonal = bbox.Diagonal
    length = diagonal.Length
#    extension_factor = length
    extension_factor = (length / 2.0)
    start_extended = rg.Point3d.Add(start, rg.Vector3d(start - center) * extension_factor)
    end_extended = rg.Point3d.Add(end, rg.Vector3d(end - center) * extension_factor)
    
#    return start_extended
    
    # 复制分割线并向左右两侧都复制一份
    up_start = rg.Point3d(start_extended.X, start_extended.Y - diagonal.Y/2.0 - offset, 0)
    up_end = rg.Point3d(end_extended.X, end_extended.Y - diagonal.Y/2.0 - offset, 0)
    
    down_start = rg.Point3d(start_extended.X, start_extended.Y + diagonal.Y/2.0 + offset, 0)
    down_end = rg.Point3d(end_extended.X, end_extended.Y + diagonal.Y/2.0 + offset, 0)

#    return [up_start, up_end, down_start, down_end]

    # 将分割线的起点终点与复制结果的起点终点对应连线，组合成为两个矩形
    up_up_cup = rg.LineCurve(start_extended, up_start)
    up_down_cup = rg.LineCurve(end_extended, up_end)
    up_start_cup = rg.LineCurve(start_extended, end_extended)
    up_end_cup = rg.LineCurve(up_start, up_end)
    
    down_up_cup = rg.LineCurve(start_extended, down_start)
    down_down_cup = rg.LineCurve(end_extended, down_end)
    down_start_cup = rg.LineCurve(start_extended, end_extended)
    down_end_cup = rg.LineCurve(down_start, down_end)
    
    # 连线为两个Zones
    
    up_zone = rg.Curve.JoinCurves([up_up_cup, up_down_cup, up_start_cup, up_end_cup])[0]
    down_zone = rg.Curve.JoinCurves([down_up_cup, down_down_cup, down_start_cup, down_end_cup])[0]
    
    # 传回结果
    return [down_zone, up_zone]

a = generate_rectangles(base)
# ---------- end north_south_zones ----------
west_east_zones = GhPythonScript(base=project.Geometry)  # -> a; inputs base: Curve
# ---------- west_east_zones: Python ----------
import Rhino.Geometry as rg

def generate_rectangles(base, offset=10.0):
    # 找到多边形的纵向分割线
    bbox = base.GetBoundingBox(True)
    center = bbox.Center
    start = rg.Point3d(center.X, bbox.Min.Y, 0)
    end = rg.Point3d(center.X, bbox.Max.Y, 0)

    # 将分割线延长到可包裹多边形的纵向长度
    diagonal = bbox.Diagonal
    length = diagonal.Length
#    extension_factor = length
    extension_factor = (length / 2.0)
    start_extended = rg.Point3d.Add(start, rg.Vector3d(start - center) * extension_factor)
    end_extended = rg.Point3d.Add(end, rg.Vector3d(end - center) * extension_factor)

    # 复制分割线并向左右两侧都复制一份
    left_start = rg.Point3d(start_extended.X - diagonal.X/2.0 - offset, start_extended.Y, 0)
    left_end = rg.Point3d(end_extended.X - diagonal.X/2.0 - offset, end_extended.Y, 0)
    
    right_start = rg.Point3d(start_extended.X + diagonal.X/2.0 + offset, start_extended.Y, 0)
    right_end = rg.Point3d(end_extended.X + diagonal.X/2.0 + offset, end_extended.Y, 0)

    # 将分割线的起点终点与复制结果的起点终点对应连线，组合成为两个矩形
    left_up_cup = rg.LineCurve(start_extended, left_start)
    left_down_cup = rg.LineCurve(end_extended, left_end)
    left_start_cup = rg.LineCurve(start_extended, end_extended)
    left_end_cup = rg.LineCurve(left_start, left_end)
    
    right_up_cup = rg.LineCurve(start_extended, right_start)
    right_down_cup = rg.LineCurve(end_extended, right_end)
    right_start_cup = rg.LineCurve(start_extended, end_extended)
    right_end_cup = rg.LineCurve(right_start, right_end)
    
    # 连线为两个Zones
    
    left_zone = rg.Curve.JoinCurves([left_up_cup, left_down_cup, left_start_cup, left_end_cup])[0]
    right_zone = rg.Curve.JoinCurves([right_up_cup, right_down_cup, right_start_cup, right_end_cup])[0]
    
    # 传回结果
    return [left_zone, right_zone]

a = generate_rectangles(base)
# ---------- end west_east_zones ----------

# ----
# 1- Base center
number_slider = Slider(5, range=0..26)
curve = Curve(split_base.splited_space)
area = Area(Geometry=curve)  # -> Area, Centroid
move = Move(Geometry=area.Centroid, Motion=Vector(0, 0, 10))  # -> Geometry, Transform
point_list = PointList(Points=move.Geometry, Size=number_slider)
item_index = ItemIndex(List=area.Centroid, Item=area.Centroid)
colour_picker = ColourPicker(PickedColour=RGB(34, 38, 29))
justifiedtext3d = JustifiedText3d(
    Location=area.Centroid,
    Text=item_index,
    Size=Slider(8, range=0..100),
    Color=colour_picker,
    HorizontalAlignment=1,
    VerticalAlginment=1,
    Font="Impact",
    UseMeshes=False,
    Bake=False)

ground_floor_height = Slider(4, range=0..10)
room_depth = Slider(9, range=0..10)
floors_height = Slider(3, range=0..10)
corridor_width = Slider(1.5, range=0..1.5)
room_width = Slider(2.6, range=0..2.6)
building_spacing = Slider(13, range=0..13)
staircase_width = Slider(2.6, range=0..2.6)
elevator_width = Slider(3.5, range=0..3.5)
cherry_picker = CherryPicker(split_base.splited_space, ListIndex=1)
curve_2 = Curve()
list_item = ListItem(List=split_base.splited_space, Index="1", Wrap=True)
curve_3 = Curve(split_base.splited_space)
curve_4 = Curve(split_base.splited_space)
discontinuity = Discontinuity(Curve=split_base.splited_space, Level=1)  # -> simplify(Points), Parameters
c_script = CSharpScript(x=curve_3)  # -> out, A; inputs x: Curve
# ---------- c_script: C# ----------
    A = x.Offset(AreaMassProperties.Compute(x).Centroid, Rhino.Geometry.Plane.WorldXY.Normal, 5, 0.001, CurveOffsetCornerStyle.Sharp)[0];
# ---------- end c_script ----------
curve_5 = Curve(<curve referenced from the Rhino model>)
judgeblocks = JudgeBlocks(
    Base=split_base.setbacked_base,
    Lands=curve_4,
    FloorNum=wlc_floors_num,
    StandardFloorHeight=floors_height,
    GroundFloorHeight=ground_floor_height,
    RoomDepth=room_depth,
    RoomWidth=room_width,
    CorridorWidth=corridor_width,
    StaircaseWidth=staircase_width,
    ElevatorWidth=elevator_width,
    BuildingSpacing=building_spacing,
    ZoneWestEast=west_east_zones,
    ZoneNorthSouth=north_south_zones)  # -> Geometries, AllGreenLand, AllBuildings, Temporary, AllFloors, AllFloorsPath, SingleBlocks, JudgeBlocks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
explode = Explode(Recursive=True)  # -> Segments, Vertices

# ----
# Economic cofficients
plot_ratio = Number(judgeblocks.PlotRatio)
building_density = Number(judgeblocks.BuildingDensity)
greening_rate = Number(judgeblocks.GreenRatio)
room_unit_count = Integer(judgeblocks.RoomNum)
expression = Expression(x=plot_ratio, Expression="Format(\"{0:0.0}\", x)")
expression_2 = Expression(x=building_density, Expression="Format(\"{0:p1}\", x)")
expression_3 = Expression(x=greening_rate, Expression="Format(\"{0:p1}\", x)")
plot_ratio_2 = Panel(expression)
building_density_2 = Panel(expression_2)
greening_rate_2 = Panel(expression_3)
room_unit_count_2 = Panel(room_unit_count)

list_item_2 = ListItem(List=split_base.splited_space, Index=Slider(4, range=0..7), Wrap=True)
deconstruct_brep = DeconstructBrep(Brep=list_item_2)  # -> Faces, Edges, Vertices
param_viewer = ParamViewer(discontinuity.Points)
gene_pool_and_slider_shuffler = GenePoolAndSliderShuffler(BooleanButton=Button())
fillet_distance = FilletDistance(Curve=judgeblocks.AllGreenLand, Distance=Slider(1.1, range=0..2))
panel_2 = Panel(discontinuity.Points)
brep = Brep(judgeblocks.JudgeBlocks)
param_viewer_2 = ParamViewer(judgeblocks.AllBuildings)

box = Box({Plane=PlaneXY(-8.560175604, -1.264502437, 0), X=Domain(0, 2.471904422), Y=Domain(0, 4.449427959), Z=Domain(0, 3.283489779)})
c_script_2 = CSharpScript(input=judgeblocks.AllBuildings, brep=box)  # -> out, A; inputs input: list of Brep, brep: Brep
# ---------- c_script_2: C# ----------
    if(input == null || input.Count == 0){
      A = brep;
    }
    else{
      A = input;
    }
# ---------- end c_script_2 ----------

number_slider_2 = Slider(3, range=1..3)  # disabled
geometry_pipeline_3 = GeometryPipeline(
    GroupByLayer=False,
    GroupByType=False,
    IncludeHidden=True,
    IncludeLocked=True,
    LayerFilter="Context::near_building",
    NameFilter="*",
    SublayerFiltering=True,
    TypeFilter=1073741848)

# ---- group: Visualization / Base_geometry
base = Curve(geometry_pipeline)
setback_base = Curve(split_base.setbacked_base)
splited_lands = Curve(split_base.splited_space)
buildings = Geometry(judgeblocks.AllBuildings)
contexts = Geometry(geometry_pipeline_3)
green_lands = Surface(fillet_distance)

# ---- group: Visualization / Shading
brep_wireframe = BrepWireframe(Brep=contexts, Density=-1)
brep_wireframe_2 = BrepWireframe(Brep=[buildings, green_lands], Density=-1)
colour_swatch = ColourSwatch(SwatchColor=RGB(0, 0, 0))
colour_swatch_2 = ColourSwatch(SwatchColor=RGB(94, 94, 94))
colour_swatch_3 = ColourSwatch(SwatchColor=RGB(203, 227, 170))
number_slider_3 = Slider(1, range=0..10)
colour_swatch_4 = ColourSwatch(SwatchColor=RGB(117, 188, 224))
colour_swatch_5 = ColourSwatch(SwatchColor=RGB(0, 0, 0))
number_slider_4 = Slider(1, range=0..10)
colour_swatch_6 = ColourSwatch(SwatchColor=RGB(0, 0, 0))
number_slider_5 = Slider(1, range=0..10)
colour_swatch_7 = ColourSwatch(SwatchColor=RGB(239, 245, 186))
colour_swatch_8 = ColourSwatch(SwatchColor=RGB(255, 255, 255))

# ---- group: Greening Rate
panel_3 = Panel("30")  # disabled
panel_4 = Panel("0")  # disabled
expression_4 = Expression(value=panel_3, upper=panel_4, lower=panel_3, Expression="Abs(upper-value) - Abs(lower-value)")  # disabled

panel_5 = Panel("0.3")
panel_6 = Panel("0")

# ---- group: Building Density
panel_7 = Panel("38")  # disabled
panel_8 = Panel("0")  # disabled
expression_5 = Expression(value=judgeblocks.BuildingDensity, upper=panel_7, lower=panel_8, Expression="Abs(upper-value) - Abs(lower-value)")  # disabled

panel_9 = Panel("0.38")
panel_10 = Panel("0.25")

# ----
solid_union = SolidUnion(Breps=flatten(judgeblocks.AllBuildings))
deconstruct_brep_2 = DeconstructBrep(Brep=solid_union)  # -> Faces, Edges, Vertices; disabled
deconstruct_box = DeconstructBox(Box=solid_union)  # -> Plane, X, Y, Z; disabled
cherry_picker_2 = CherryPicker(deconstruct_brep_2.Faces, ListIndex=0)  # disabled

panel_11 = Panel("1.7")  # disabled
panel_12 = Panel("1.5")  # disabled
expression_6 = Expression(value=number_slider_2, upper=panel_11, lower=panel_12, Expression="Abs(upper-value) - Abs(lower-value)")  # disabled
c_script_3 = CSharpScript(target=judgeblocks.PlotRatio, lowerBound=panel_12, upperBound=panel_11)  # -> out, A; inputs target: Double, lowerBound: Double, upperBound: Double; disabled
# ---------- c_script_3: C# ----------
    A = TransformValue(target, lowerBound, upperBound);
# ---------- c_script_3: C# additional code ----------
  public static double TransformValue(double input, double lowerBound, double upperBound)
  {
    // 设置一个缩放因子以调整函数的高度
    double scale = 10;

    if (input >= lowerBound && input <= upperBound)
    {
      // 在范围内，输入值越大转化值越小，所以使用a*(x-h)^3 + k形式的三次函数，其中h为最低点
      double h = upperBound;
      return scale * Math.Pow(input - h, 3) + 1;
    }
    else
    {
      // 在范围外，越接近范围边缘，转化值越小，越远离越大，所以使用(Math.Abs(input - lowerBound))^3 或 (Math.Abs(input - upperBound))^3
      if (input < lowerBound)
        return scale * Math.Pow(Math.Abs(input - lowerBound), 3) + 1;
      else
        return scale * Math.Pow(Math.Abs(input - upperBound), 3) + 1;
    }
  }
# ---------- end c_script_3 ----------
number = Number(c_script_3.A)  # disabled

# ---- group: Visualization / Displayer
custom_preview_lineweights = CustomPreviewLineweights(Geometry=[base, setback_base], Shader=colour_swatch, Thickness=number_slider_3, Absolute=False)
custom_preview_materials = CustomPreviewMaterials(Geometry=contexts, DiffuseColor=colour_swatch_7)
custom_preview_lineweights_2 = CustomPreviewLineweights(Geometry=splited_lands, Shader=colour_swatch_2, Thickness=number_slider_3, Absolute=False)
custom_preview_lineweights_3 = CustomPreviewLineweights(Geometry=brep_wireframe_2, Shader=colour_swatch_5, Thickness=number_slider_4, Absolute=False)
custom_preview_lineweights_4 = CustomPreviewLineweights(Geometry=brep_wireframe, Shader=colour_swatch_6, Thickness=number_slider_5, Absolute=False)
custom_preview_materials_2 = CustomPreviewMaterials(Geometry=green_lands, DiffuseColor=colour_swatch_3)
custom_preview = CustomPreview(Geometry=buildings, Material=colour_swatch_8)

# ----
number_slider_6 = Slider(30, range=0..30)  # disabled
base_2 = BoundarySurfaces(Edges=project.Geometry)

# ---- group: Room-Unit Count
one_over_x = OneOverX(Value=judgeblocks.RoomNum)

one_over_x_2 = OneOverX(Value=judgeblocks.RoomNum)  # disabled

# ----
ghpython_script = GhPythonScript(input=judgeblocks.PlotRatio, upper=panel_11, lower=panel_12)  # -> out, output; disabled
# ---------- ghpython_script: Python ----------
__author__ = "tianf"
__version__ = "2021.12.15"

if lower < input <= upper:
    output = abs(upper-input) - abs(lower-input)
elif upper < input:
    output = abs(upper-input) + abs(lower-input)
elif lower >= input:
    output = abs(upper-input)-abs(lower-input)
# ---------- end ghpython_script ----------
c_script_4 = CSharpScript(target=judgeblocks.GreenRatio, lowerBound=panel_6, upperBound=panel_5)  # -> out, A; inputs target: Double, lowerBound: Double, upperBound: Double; same code as c_script_3
c_script_5 = CSharpScript(target=number_slider_6, lowerBound=panel_7, upperBound=panel_8)  # -> out, A; inputs target: Double, lowerBound: Double, upperBound: Double; disabled; same code as c_script_3
number_slider_7 = Slider(1, range=0..1)
expression_7 = Expression(value=number_slider_7, upper=panel_9, lower=panel_10, Expression="Abs(upper-value) + Abs(lower-value)")
c_script_6 = CSharpScript(target=number_slider_7, lowerBound=panel_9, upperBound=panel_10)  # -> out, A; inputs target: Double, lowerBound: Double, upperBound: Double; same code as c_script_3
number_slider_8 = Slider(1.7, range=0..2)  # disabled
number_2 = Number(expression_5)  # disabled
number_3 = Number(one_over_x_2)  # disabled
number_4 = Number()  # disabled
number_5 = Number(expression_7)
number_6 = Number(c_script_4.A)
number_7 = Number(one_over_x)
panel_13 = Panel(expression_7)
list_item_3 = ListItem(Index=0, Wrap=True)
panel_14 = Panel(judgeblocks.PlotRatio)
panel_15 = Panel(number_3)  # disabled
panel_16 = Panel(judgeblocks.RoomNum)
panel_17 = Panel(judgeblocks.GreenRatio)
panel_18 = Panel(c_script_5.A)  # disabled
panel_19 = Panel(c_script_3.A)  # disabled
ghpython_script_2 = GhPythonScript()  # -> out, a; disabled
# ---------- ghpython_script_2: Python ----------
__author__ = "eastnoob"
__version__ = "2023.08.07"



def fitness_func(target):
    if target >= 1.5 and target <= 1.7:
        # 在1.5-1.7范围内，适应度随着目标值的增加而减小
        fitness = 2.0 - (target - 1.5) ** 2
    else:
        # 在1.5-1.7范围外，适应度随着目标值距离范围的远近而减小
        if target < 1.5:
            distance = 1.5 - target
        else:
            distance = target - 1.7
        fitness = 1.0 / (1.0 + distance ** 2)
    return fitness
# ---------- end ghpython_script_2 ----------

c_script_7 = CSharpScript(input=number_6, brep="100000")  # -> out, A; inputs brep: Double
# ---------- c_script_7: C# ----------
    if(input == null){
      A = brep;
    }
    else{
      A = input;
    }
//     || input.Count == 0
# ---------- end c_script_7 ----------

c_script_8 = CSharpScript(input=number_5, brep="100000")  # -> out, A; inputs brep: Double; same code as c_script_7

c_script_9 = CSharpScript(input=number_7, brep="100000")  # -> out, A; inputs brep: Double; same code as c_script_7

panel_20 = Panel(c_script_8.A)
panel_21 = Panel(c_script_7.A)
panel_22 = Panel(c_script_9.A)
wlc_buildingdensity = Number(c_script_8.A)
wlc_roomcount = Number(c_script_9.A)
wlc_greenratio = Number(c_script_7.A)
merge = Merge(Data1=judgeblocks.AllGreenLand, Data2=judgeblocks.AllBuildings)
number_slider_9 = Slider(10, range=0..10)
number_slider_10 = Slider(5, range=0..10)

# ----
# Sunlighting time
number_slider_11 = Slider(22, range=0..30)
number_slider_12 = Slider(12, range=0..12)
analysisperiod = LBAnalysisPeriod(
    start_month=number_slider_12,
    start_day=number_slider_11,
    start_hour=Slider(0, range=0..12),
    end_month=number_slider_12,
    end_day=number_slider_11,
    end_hour=Slider(23, range=0..24))  # -> period, hoys, dates; plug-in component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
constrloc = LBConstructLocation(name="Qingdao", latitude="36.13", longitude="120.36", time_zone="8", elevation="11")  # -> location; plug-in component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
sunpath = LBSunPath(location=constrloc, hoys=analysisperiod.hoys, scale=Slider(2, range=0..10))  # -> out, vectors, altitudes, azimuths, hoys, sun_pts, analemma, daily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; plug-in component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
surrounding_buildings = Brep(geometry_pipeline_3)
building = Brep(flatten(solid_union))
gride_size = Slider(2, range=0..30)

context = Merge(Data1=surrounding_buildings, Data2=base_2)

directsunhours = LBDirectSunHours(
    vectors=flatten(sunpath.vectors),
    geometry=flatten(building),
    context=flatten(context),
    grid_size=gride_size,
    run=Toggle(True))  # -> out, points, results, mesh, legend, title, int_mtx; plug-in component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

# ---- group: Total Sunlight Hour
mass_addition = MassAddition(Input=directsunhours.results)  # -> Result, PartialResults; disabled
one_over_x_3 = OneOverX(Value=mass_addition.Result)  # disabled

mass_addition_2 = MassAddition(Input=directsunhours.results)  # -> Result, PartialResults
one_over_x_4 = OneOverX(Value=mass_addition_2.Result)

# ----
number_8 = Number(one_over_x_3)  # disabled
number_9 = Number(one_over_x_4)
c_script_10 = CSharpScript(value="0", list=directsunhours.results)  # -> out, A; inputs value: Int32, list: list of Int32; disabled
# ---------- c_script_10: C# ----------
    int count = 0;
    foreach (var item in list)
    {
      if (item == value)
      {
        count++;
      }
    }
    A = count;
# ---------- end c_script_10 ----------
panel_23 = Panel(mass_addition_2.Result)
panel_24 = Panel(mass_addition.Result)  # disabled

c_script_11 = CSharpScript(input=number_9, brep="100000")  # -> out, A; inputs brep: Double; same code as c_script_7

panel_25 = Panel(c_script_11.A)
wlc_sunlighthours = Number(c_script_11.A)

c_script_12 = CSharpScript(target=judgeblocks.PlotRatio, lowerBound="1.5", upperBound="1.7")  # -> out, A; inputs target: Double, lowerBound: Double, upperBound: Double; same code as c_script_3

expression_8 = Expression(value=number_slider_7, upper="1.7", lower="1.5", Expression="Abs(upper-value) + Abs(lower-value)")

number_10 = Number(expression_8)

c_script_13 = CSharpScript(input=number_10, brep="100000")  # -> out, A; inputs brep: Double; same code as c_script_7

panel_26 = Panel(c_script_13.A)
wlc_plotratio = Number(c_script_13.A)
wallacei_x = WallaceiX(
    Genes=[wlc_split_degree, wlc_split_direction, wlc_floors_num],
    Objectives=[wlc_sunlighthours, wlc_roomcount, wlc_buildingdensity, wlc_plotratio],
    allFitness="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",
    allGenomes="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",
    curFrontIdx="1|0;1|1",
    curFrontIdxSave="0|33;1|0;1|1",
    popGen="50,20",
    total="0",
    wlcDone=False)  # -> WallaceiGenomes, FitnessValues, Data, Phenotypes
