# Grasshopper definition main.gh (Grasshopper 1.0.7)
# plug-ins: Wallacei, TianParameterModelForOpt, Human

# ---- group: Split direction
wlc_split_direction = GenePool(
    Decimals=0,
    Maximum=1,
    Minimum=0,
    Value=[0.5527136543, 0.9021251116, 0.1719699825, 0.08635945113, 0.2032259019, 0.3502267035, 0.01642610148])
split_direction = Panel(wlc_split_direction)

# ---- group: Split degree
wlc_split_degree = GenePool(
    Decimals=6,
    Maximum=1,
    Minimum=0,
    Value=[0.1992688027, 0.7588914802, 0.2490609806, 0.2087750675, 0.1323946394, 0.7159115102, 0.04476275657])
split_degree = Panel(wlc_split_degree)

# ---- group: Floors num
wlc_floors_num = GenePool(
    Decimals=0,
    Maximum=6,
    Minimum=4,
    Value=[5.49444753, 5.741011087, 4.686711915, 4.19443918, 4.962069028, 4.459410974, 4.019398767, 5.574804302])
floors_number = Panel(wlc_floors_num)

# ----
xy_plane = XYPlane(Origin=Point(0, 0, 0))

# ---- group: Base line
# 01-subdivision base
geometry_pipeline = GeometryPipeline(
    GroupByLayer=False,
    GroupByType=False,
    IncludeHidden=True,
    IncludeLocked=True,
    LayerFilter="boundary",
    NameFilter="*",
    SublayerFiltering=True,
    TypeFilter=4)
geometry_pipeline_2 = GeometryPipeline(
    GroupByLayer=False,
    GroupByType=False,
    IncludeHidden=True,
    IncludeLocked=True,
    LayerFilter="boundary_back",
    NameFilter="*",
    SublayerFiltering=True,
    TypeFilter=4)
project = Project(Geometry=geometry_pipeline, Plane=xy_plane)  # -> Geometry, Transform

# ----
panel = Panel("""1
1
1
0.5
0.01
0.64
0.69""")
graft_tree = GraftTree(Tree=panel, IncludeEmptyLists=True, IncludeNullItems=True)

# ---- group: Subdivision base
split_base = GhPythonScript(
    project_base=project.Geometry,
    split_direction=wlc_split_direction,
    split_degree=wlc_split_degree,
    setback="-5",
    rotate_angle=Slider(72, range=0..100))  # -> out, splited_space, setbacked_base; inputs project_base: Curve, split_direction: list of Int32, split_degree: list
# ---------- split_base: Python ----------
# coding=utf-8
"""
                       _oo0oo_
                      o8888888o
                      88" . "88
                      (| -_- |)
                      0\  =  /0
                    ___/`---'\___
                  .' \\|     |// '.
                 / \\|||  :  |||// \
                / _||||| -:- |||||- \
               |   | \\\  - /// |   |
               | \_|  ''\---/''  |_/ |
               \  .-\__  '-'  ___/-. /
             ___'. .'  /--.--\  `. .'___
          ."" '<  `.___\_<|>_/___.' >' "".
         | | :  `- \`.;`\ _ /`;.`/ - ` : | |
         \  \ `_.   \_ __\ /__ _/   .-` /  /
     =====`-.____`.___ \_____/___.-`___.-'=====
                       `=---='


     ~~~~~~~~~~~~~~~~~~~~~~~~~~~~~~~~~~~~~~~~~~~

           佛祖保佑       永不宕机     永无BUG
"""

import Rhino.Geometry as rh
from scriptcontext import doc
import rhinoscriptsyntax as rs

ds = _split_direction
ss = _split_degree
#curve = _project_base

tol = doc.ModelAbsoluteTolerance

## setback the base
base_polyline = rh.PolylineCurve.ToPolyline(rh.Curve.ToPolyline(_project_base, tol, tol, 1000, 1000))
centpt = rh.Polyline.CenterPoint(base_polyline)
XYplane = rh.Plane(centpt, rs.coerce3dvector([0, 0, 1]))

condition = rh.CurveOffsetCornerStyle.Sharp
array_setback = rh.Curve.Offset(_project_base, XYplane, _setback, tol, condition)

if len(array_setback) > 1:
    jointed_setback = rh.Curve.JoinCurves(array_setback)
else:
    jointed_setback = array_setback

curve = jointed_setback[0]

## function to split one curve by direction (d) and split (s) parameter

def rotate_bounding_box(base, bounding, angle):
    ## Not be used
    
    centpt = rh.AreaMassProperties.Compute(_project_base).Centroid
    scale = rh.Transform.Scale(rh.Plane.WorldXY, 5, 5, 1)
    rotate = rh.Transform.Rotation(angle, rh.Plane.WorldXY.ZAxis, centpt)
    
    bounding.Transform(scale)
    bounding.Transform(rotate)
    
    return bounding

def split_curve(curve, d, s):
    #    bb = rh.Curve.GetBoundingBox(
    
    bb = curve.GetBoundingBox(True)
#    bbo = curve.GetBoundingBox(True)
#    bb = rotate_bounding_box(curve, bbo, _rotate_angle)
    
    base_pt = rh.Point3d(bb.Min.X, bb.Min.Y, 0.0)
    
    x = bb.Max.X - bb.Min.X
    y = bb.Max.Y - bb.Min.Y
#    print(x, y)
    dims = [x, y]
    vecs = [rh.Vector3d(1,0,0), rh.Vector3d(0,1,0)]
    
    vec_1 = vecs[d] * dims[d] * s
    new_pt_1 = rh.Point3d(base_pt)
    new_pt_1.Transform(rh.Transform.Translation(vec_1))
    
    other_dir = abs(d - 1)
    
    vec_2 = vecs[other_dir] * dims[other_dir]
    new_pt_2 = rh.Point3d(new_pt_1)
    new_pt_2.Transform(rh.Transform.Translation(vec_2))
    
    
    split_line = rh.Line(new_pt_1, new_pt_2).ToNurbsCurve()
    
    inter = rh.Intersect.Intersection.CurveCurve(curve, split_line, tol, tol)
    p = [i.ParameterA for i in inter]
    
    if len(p) > 2:
        for i in range(len(p)):
            
            pt1 = curve.PointAt(p[i-1])
            pt2 = curve.PointAt(p[i])
            
            line = rh.Line(pt1, pt2).ToNurbsCurve()
            cp = line.PointAtNormalizedLength(0.5)
            
            if (curve.Contains(cp) == rh.PointContainment.Inside and 
                    len(rh.Intersect.Intersection.CurveCurve(curve, line, tol, tol)) <= 2):
                p = [p[i-1], p[i]]
                break
    
    pieces = curve.Split(p)
    
    curves = []
    
    for piece in pieces:
        line = rh.Line(piece.PointAtStart, piece.PointAtEnd)
        curve = rh.NurbsCurve.JoinCurves([piece, line.ToNurbsCurve()])
        curves += curve
    
    return curves


def split_recursively(curves, ds, ss):
    
    if len(ds) == 0 or len(ss) == 0:
        return curves
    
    curve = curves.pop(0)
    d = ds.pop(0)
    s = ss.pop(0)
    
    curves += split_curve(curve, d, s)
    
    print(len(curves))
    
    return split_recursively(curves, ds, ss)
print(curve)
print(ds)
print(ss)

splited_space_ = split_recursively([curve], ds, ss)
setbacked_base_ = curve
# ---------- end split_base ----------
north_south_zones = GhPythonScript(base=project.Geometry)  # -> a; inputs base: Curve
# ---------- north_south_zones: Python ----------
import Rhino.Geometry as rg

def generate_rectangles(base, offset=10.0):
    # 找到多边形的纵向分割线
    bbox = base.GetBoundingBox(True)
    center = bbox.Center
    start = rg.Point3d(bbox.Min.X, center.Y, 0)
    end = rg.Point3d(bbox.Max.X, center.Y, 0)

    # 将分割线延长到可包裹多边形的纵向长度
    diagonal = bbox.Diagonal
    length = diagonal.Length
#    extension_factor = length
    extension_factor = (length / 2.0)
    start_extended = rg.Point3d.Add(start, rg.Vector3d(start - center) * extension_factor)
    end_extended = rg.Point3d.Add(end, rg.Vector3d(end - center) * extension_factor)
    
#    return start_extended
    
    # 复制分割线并向左右两侧都复制一份
    up_start = rg.Point3d(start_extended.X, start_extended.Y - diagonal.Y/2.0 - offset, 0)
    up_end = rg.Point3d(end_extended.X, end_extended.Y - diagonal.Y/2.0 - offset, 0)
    
    down_start = rg.Point3d(start_extended.X, start_extended.Y + diagonal.Y/2.0 + offset, 0)
    down_end = rg.Point3d(end_extended.X, end_extended.Y + diagonal.Y/2.0 + offset, 0)

#    return [up_start, up_end, down_start, down_end]

    # 将分割线的起点终点与复制结果的起点终点对应连线，组合成为两个矩形
    up_up_cup = rg.LineCurve(start_extended, up_start)
    up_down_cup = rg.LineCurve(end_extended, up_end)
    up_start_cup = rg.LineCurve(start_extended, end_extended)
    up_end_cup = rg.LineCurve(up_start, up_end)
    
    down_up_cup = rg.LineCurve(start_extended, down_start)
    down_down_cup = rg.LineCurve(end_extended, down_end)
    down_start_cup = rg.LineCurve(start_extended, end_extended)
    down_end_cup = rg.LineCurve(down_start, down_end)
    
    # 连线为两个Zones
    
    up_zone = rg.Curve.JoinCurves([up_up_cup, up_down_cup, up_start_cup, up_end_cup])[0]
    down_zone = rg.Curve.JoinCurves([down_up_cup, down_down_cup, down_start_cup, down_end_cup])[0]
    
    # 传回结果
    return [down_zone, up_zone]

a = generate_rectangles(base)
# ---------- end north_south_zones ----------
west_east_zones = GhPythonScript(base=project.Geometry)  # -> a; inputs base: Curve
# ---------- west_east_zones: Python ----------
import Rhino.Geometry as rg

def generate_rectangles(base, offset=10.0):
    # 找到多边形的纵向分割线
    bbox = base.GetBoundingBox(True)
    center = bbox.Center
    start = rg.Point3d(center.X, bbox.Min.Y, 0)
    end = rg.Point3d(center.X, bbox.Max.Y, 0)

    # 将分割线延长到可包裹多边形的纵向长度
    diagonal = bbox.Diagonal
    length = diagonal.Length
#    extension_factor = length
    extension_factor = (length / 2.0)
    start_extended = rg.Point3d.Add(start, rg.Vector3d(start - center) * extension_factor)
    end_extended = rg.Point3d.Add(end, rg.Vector3d(end - center) * extension_factor)

    # 复制分割线并向左右两侧都复制一份
    left_start = rg.Point3d(start_extended.X - diagonal.X/2.0 - offset, start_extended.Y, 0)
    left_end = rg.Point3d(end_extended.X - diagonal.X/2.0 - offset, end_extended.Y, 0)
    
    right_start = rg.Point3d(start_extended.X + diagonal.X/2.0 + offset, start_extended.Y, 0)
    right_end = rg.Point3d(end_extended.X + diagonal.X/2.0 + offset, end_extended.Y, 0)

    # 将分割线的起点终点与复制结果的起点终点对应连线，组合成为两个矩形
    left_up_cup = rg.LineCurve(start_extended, left_start)
    left_down_cup = rg.LineCurve(end_extended, left_end)
    left_start_cup = rg.LineCurve(start_extended, end_extended)
    left_end_cup = rg.LineCurve(left_start, left_end)
    
    right_up_cup = rg.LineCurve(start_extended, right_start)
    right_down_cup = rg.LineCurve(end_extended, right_end)
    right_start_cup = rg.LineCurve(start_extended, end_extended)
    right_end_cup = rg.LineCurve(right_start, right_end)
    
    # 连线为两个Zones
    
    left_zone = rg.Curve.JoinCurves([left_up_cup, left_down_cup, left_start_cup, left_end_cup])[0]
    right_zone = rg.Curve.JoinCurves([right_up_cup, right_down_cup, right_start_cup, right_end_cup])[0]
    
    # 传回结果
    return [left_zone, right_zone]

a = generate_rectangles(base)
# ---------- end west_east_zones ----------

# ----
# 1- Base center
curve = Curve(split_base.splited_space)
area = Area(Geometry=curve)  # -> Area, Centroid
point_list = PointList(Points=area.Centroid, Size=Slider(5, range=0..26))

ground_floor_height = Slider(4, range=0..10)
room_depth = Slider(9, range=0..10)
floors_height = Slider(3, range=0..10)
corridor_width = Slider(1.5, range=0..1.5)
room_width = Slider(2.6, range=0..2.6)
building_spacing = Slider(13, range=0..13)
staircase_width = Slider(2.6, range=0..2.6)
elevator_width = Slider(3.5, range=0..3.5)
cherry_picker = CherryPicker(split_base.splited_space, ListIndex=1)
curve_2 = Curve()
list_item = ListItem(List=split_base.splited_space, Index="1", Wrap=True)
curve_3 = Curve(split_base.splited_space)
curve_4 = Curve(split_base.splited_space)
discontinuity = Discontinuity(Curve=split_base.splited_space, Level=1)  # -> simplify(Points), Parameters
c_script = CSharpScript(x=curve_3)  # -> out, A; inputs x: Curve
# ---------- c_script: C# ----------
    A = x.Offset(AreaMassProperties.Compute(x).Centroid, Rhino.Geometry.Plane.WorldXY.Normal, 5, 0.001, CurveOffsetCornerStyle.Sharp)[0];
# ---------- end c_script ----------
curve_5 = Curve(<curve referenced from the Rhino model>)
explode = Explode(Recursive=True)  # -> Segments, Vertices
list_item_2 = ListItem(List=split_base.splited_space, Index=Slider(3, range=0..7), Wrap=True)
judgeblocks = JudgeBlocks(
    Base=split_base.setbacked_base,
    Lands=list_item_2,
    FloorNum=wlc_floors_num,
    StandardFloorHeight=floors_height,
    GroundFloorHeight=ground_floor_height,
    RoomDepth=room_depth,
    RoomWidth=room_width,
    CorridorWidth=corridor_width,
    StaircaseWidth=staircase_width,
    ElevatorWidth=elevator_width,
    BuildingSpacing=building_spacing,
    ZoneWestEast=west_east_zones,
    ZoneNorthSouth=north_south_zones)  # -> Geometries, AllGreenLand, AllBuildings, Temporary, AllFloors, AllFloorsPath, SingleBlocks, JudgeBlocks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

# ----
# Economic cofficients
plot_ratio = Number(judgeblocks.PlotRatio)
building_density = Number(judgeblocks.BuildingDensity)
greening_rate = Number(judgeblocks.GreenRatio)
room_unit_count = Integer(judgeblocks.RoomNum)
expression = Expression(x=plot_ratio, Expression="Format(\"{0:0.0}\", x)")
expression_2 = Expression(x=building_density, Expression="Format(\"{0:0.0}%\", x)")
expression_3 = Expression(x=greening_rate, Expression="Format(\"{0:0.0}%\", x)")
plot_ratio_2 = Panel(expression)
building_density_2 = Panel(expression_2)
greening_rate_2 = Panel(expression_3)
room_unit_count_2 = Panel(room_unit_count)

deconstruct_brep = DeconstructBrep(Brep=list_item_2)  # -> Faces, Edges, Vertices
param_viewer = ParamViewer(discontinuity.Points)
gene_pool_and_slider_shuffler = GenePoolAndSliderShuffler(BooleanButton=Button())
curve_6 = Curve()
fillet_distance = FilletDistance(Curve=judgeblocks.AllGreenLand, Distance=Slider(1.1, range=0..2))
wallacei_x = WallaceiX(popGen="-1,-1", total="0", wlcDone=False)  # -> WallaceiGenomes, FitnessValues, Data, Phenotypes
panel_2 = Panel(discontinuity.Points)
brep = Brep(judgeblocks.AllBuildings)
param_viewer_2 = ParamViewer(judgeblocks.AllBuildings)
brep_2 = Brep(judgeblocks.JudgeBlocks)
c_script_2 = CSharpScript(x=brep_2)  # -> out, A; inputs x: Brep
# ---------- c_script_2: C# ----------
    A = x.IsOriented  ;
# ---------- end c_script_2 ----------
tree_statistics = TreeStatistics()  # -> Paths, Length, Count
curve_7 = Curve(<curve referenced from the Rhino model>)
circle = Circle({Plane=Plane(origin=(-174.7759231, 27.42956056, 0), x=(0.7948427632, -0.6068154429, 0), y=(0.6068154429, 0.7948427632, 0)), Radius=43.39405812})
c_script_3 = CSharpScript(closeCurve=curve_7)  # -> out, A; inputs closeCurve: Curve
# ---------- c_script_3: C# ----------
    double offset = 1;
    double offsetOrigin = 20;
    BoundingBox boundingBox = closeCurve.GetBoundingBox(true);
    Point3d center = boundingBox.Center;

    Point3d horizontalStart = new Point3d(center.X, boundingBox.Min.Y, 0);
    Point3d horizontalEnd = new Point3d(center.X, boundingBox.Max.Y, 0);

    Point3d verticalStart = new Point3d(boundingBox.Min.X, center.Y, 0);
    Point3d verticalEnd = new Point3d(boundingBox.Max.X, center.Y, 0);

    Vector3d diagonal = boundingBox.Diagonal;
    double length = diagonal.Length;
    double extensionFactor = length / 2.0;

    Point3d horizontalStartExtended = Point3d.Add(horizontalStart, new Vector3d(horizontalStart - center) * extensionFactor);
    Point3d horizontalEndExtended = Point3d.Add(horizontalEnd, new Vector3d(horizontalEnd - center) * extensionFactor);

    Point3d verticalStartExtended = Point3d.Add(verticalStart, new Vector3d(verticalStart - center) * extensionFactor);
    Point3d verticalEndExtended = Point3d.Add(verticalEnd, new Vector3d(verticalEnd - center) * extensionFactor);

    Point3d leftStart = new Point3d(horizontalStartExtended.X - diagonal.X / 2.0 - offset, horizontalStartExtended.Y, 0);
    Point3d leftEnd = new Point3d(horizontalEndExtended.X - diagonal.X / 2.0 - offset, horizontalEndExtended.Y, 0);

    Point3d rightStart = new Point3d(horizontalStartExtended.X + diagonal.X / 2.0 + offset, horizontalStartExtended.Y, 0);
    Point3d rightEnd = new Point3d(horizontalEndExtended.X + diagonal.X / 2.0 + offset, horizontalEndExtended.Y, 0);

    Point3d topStart = new Point3d(verticalStartExtended.X, verticalStartExtended.Y + diagonal.Y / 2.0 + offset, 0);
    Point3d topEnd = new Point3d(verticalEndExtended.X, verticalEndExtended.Y + diagonal.Y / 2.0 + offset, 0);

    Point3d bottomStart = new Point3d(verticalStartExtended.X, verticalStartExtended.Y - diagonal.Y / 2.0 - offset, 0);
    Point3d bottomEnd = new Point3d(verticalEndExtended.X, verticalEndExtended.Y - diagonal.Y / 2.0 - offset, 0);

    // Generate the left, right, top, and bottom zones
    Curve westZone = GenerateZone(horizontalStartExtended, horizontalEndExtended, leftStart, leftEnd);
    westZone.Translate(new Vector3d(-offsetOrigin, 0, 0));

    Curve eastZone = GenerateZone(horizontalStartExtended, horizontalEndExtended, rightStart, rightEnd);
    eastZone.Translate(new Vector3d(offsetOrigin, 0, 0));

    Curve northZone = GenerateZone(verticalStartExtended, verticalEndExtended, topStart, topEnd);
    northZone.Translate(new Vector3d(0, offsetOrigin, 0));

    Curve southZone = GenerateZone(verticalStartExtended, verticalEndExtended, bottomStart, bottomEnd);
    southZone.Translate(new Vector3d(0, -offsetOrigin, 0));

    A = new List<Curve>{westZone, eastZone, northZone, southZone};
# ---------- c_script_3: C# additional code ----------
  // Function to generate a zone
  Curve GenerateZone(Point3d startExtended, Point3d endExtended, Point3d start, Point3d end)
  {
    LineCurve upCurve = new LineCurve(startExtended, start);
    LineCurve downCurve = new LineCurve(endExtended, end);
    LineCurve startCurve = new LineCurve(startExtended, endExtended);
    LineCurve endCurve = new LineCurve(start, end);

    Curve[] curves = new Curve[] { upCurve, downCurve, startCurve, endCurve };

    return Curve.JoinCurves(curves)[0];
  }
# ---------- end c_script_3 ----------

# ---- group: Building Density
expression_4 = Expression(value=judgeblocks.BuildingDensity, upper="38", lower="0", Expression="Abs(upper-value) - Abs(lower-value)")

# ----
cherry_picker_2 = CherryPicker(c_script_3.A, ListIndex=1)
geometry_pipeline_3 = GeometryPipeline(
    GroupByLayer=False,
    GroupByType=False,
    IncludeHidden=True,
    IncludeLocked=True,
    LayerFilter="Context::near_building",
    NameFilter="*",
    SublayerFiltering=True,
    TypeFilter=1073741848)

# ---- group: Visualization / Base_geometry
base = Curve(geometry_pipeline)
setback_base = Curve(split_base.setbacked_base)
splited_lands = Curve(split_base.splited_space)
buildings = Geometry(judgeblocks.AllBuildings)
contexts = Geometry(geometry_pipeline_3)
green_lands = Surface(fillet_distance)

# ---- group: Visualization / Shading
brep_wireframe = BrepWireframe(Brep=contexts, Density=-1)
brep_wireframe_2 = BrepWireframe(Brep=[buildings, green_lands], Density=-1)
colour_swatch = ColourSwatch(SwatchColor=RGB(0, 0, 0))
colour_swatch_2 = ColourSwatch(SwatchColor=RGB(94, 94, 94))
colour_swatch_3 = ColourSwatch(SwatchColor=RGB(203, 227, 170))
number_slider = Slider(1, range=0..10)
colour_swatch_4 = ColourSwatch(SwatchColor=RGB(117, 188, 224))
colour_swatch_5 = ColourSwatch(SwatchColor=RGB(0, 0, 0))
number_slider_2 = Slider(1, range=0..10)
colour_swatch_6 = ColourSwatch(SwatchColor=RGB(0, 0, 0))
number_slider_3 = Slider(1, range=0..10)
colour_swatch_7 = ColourSwatch(SwatchColor=RGB(239, 245, 186))
colour_swatch_8 = ColourSwatch(SwatchColor=RGB(255, 255, 255))

# ----
solid_union = SolidUnion(Breps=judgeblocks.AllBuildings)

# ---- group: Room-Unit Count
one_over_x = OneOverX(Value=judgeblocks.RoomNum)
wlc_roomunit_count = Number(one_over_x)

# ---- group: Visualization / Displayer
custom_preview_lineweights = CustomPreviewLineweights(Geometry=[base, setback_base], Shader=colour_swatch, Thickness=number_slider, Absolute=False)
custom_preview_materials = CustomPreviewMaterials(Geometry=contexts, DiffuseColor=colour_swatch_7)
custom_preview_lineweights_2 = CustomPreviewLineweights(Geometry=splited_lands, Shader=colour_swatch_2, Thickness=number_slider, Absolute=False)
custom_preview_lineweights_3 = CustomPreviewLineweights(Geometry=brep_wireframe_2, Shader=colour_swatch_5, Thickness=number_slider_2, Absolute=False)
custom_preview_lineweights_4 = CustomPreviewLineweights(Geometry=brep_wireframe, Shader=colour_swatch_6, Thickness=number_slider_3, Absolute=False)
custom_preview_materials_2 = CustomPreviewMaterials(Geometry=green_lands, DiffuseColor=colour_swatch_3)
custom_preview = CustomPreview(Geometry=buildings, Material=colour_swatch_8)

# ----
base_2 = BoundarySurfaces(Edges=project.Geometry)

# ---- group: Building Density
wlc_building_density = Number(expression_4)

# ----
curve_8 = Curve(<curve referenced from the Rhino model>)
panel_3 = Panel(wlc_building_density)
panel_4 = Panel(wlc_roomunit_count)
c_script_4 = CSharpScript(x=curve_8)  # -> out, A; inputs x: Curve
# ---------- c_script_4: C# ----------
    //    A = x;
    var b = x.Extend(CurveEnd.Both, 100, CurveExtensionStyle.Line);
    b.Translate(new Vector3d(10, 0, 0));
    
    A = b;
# ---------- end c_script_4 ----------
curve_9 = Curve(c_script_4.A)
end_points = EndPoints(Curve=curve_9)  # -> Start, End
curve_10 = Curve(<curve referenced from the Rhino model>)
c_script_5 = CSharpScript()  # -> out, A; inputs curve: Curve
# ---------- c_script_5: C# additional code ----------
  List<Curve> ExplodeCurve(Curve curve)
  {
    // 如果曲线为空，那么返回一个空列表
    if (curve == null) return new List<Curve>();

    // 如果曲线已经是线段，那么直接返回
    if (curve.IsLinear()) return new List<Curve> { curve };

    // 如果曲线是多段线，那么分段炸开
    PolyCurve polycurve = curve as PolyCurve;
    if (polycurve != null)
    {
      return polycurve.SegmentCount > 0
        ? polycurve.GetSegments().ToList()
        : new List<Curve> { curve };
    }

    // 如果曲线是多段曲线，那么分段炸开
    PolylineCurve polyline = curve as PolylineCurve;
    if (polyline != null)
    {
      return polyline.SegmentCount > 0
        ? polyline.GetSegments().ToList()
        : new List<Curve> { curve };
    }

    // 如果曲线是封闭的，那么炸开
    if (curve.IsClosed)
    {
      // 将曲线分割为多段
      Curve[] segments = curve.DuplicateSegments();
      if (segments != null) return segments.ToList();
    }

    // 如果都不是，那么返回原曲线
    return new List<Curve> { curve };
  }
# ---------- end c_script_5 ----------
merge = Merge(Data1=judgeblocks.AllGreenLand, Data2=judgeblocks.AllBuildings)

# ----
# Sunlighting time
number_slider_4 = Slider(22, range=0..30)
number_slider_5 = Slider(12, range=0..12)
analysisperiod = LBAnalysisPeriod(
    start_month=number_slider_5,
    start_day=number_slider_4,
    start_hour=Slider(0, range=0..12),
    end_month=number_slider_5,
    end_day=number_slider_4,
    end_hour=Slider(23, range=0..24))  # -> period, hoys, dates; plug-in component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
constrloc = LBConstructLocation(name="Qingdao", latitude="36.13", longitude="120.36", time_zone="8", elevation="11")  # -> location; plug-in component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
sunpath = LBSunPath(location=constrloc, hoys=analysisperiod.hoys, scale=Slider(2, range=0..10))  # -> out, vectors, altitudes, azimuths, hoys, sun_pts, analemma, daily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; plug-in component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
surrounding_buildings = Brep(geometry_pipeline_3)
building = Brep(flatten(solid_union))
gride_size = Slider(2, range=0..30)

context = Merge(Data1=surrounding_buildings, Data2=base_2)

directsunhours = LBDirectSunHours(
    vectors=flatten(sunpath.vectors),
    geometry=flatten(building),
    context=flatten(context),
    grid_size=gride_size,
    run=Toggle(True))  # -> out, points, results, mesh, legend, title, int_mtx; plug-in component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

# ---- group: Total Sunlight Hour
mass_addition = MassAddition(Input=directsunhours.results)  # -> Result, PartialResults
one_over_x_2 = OneOverX(Value=mass_addition.Result)
wlc_sunlight_hour = Number(one_over_x_2)

# ----
panel_5 = Panel(mass_addition.Result)

# ---- group: Greening Rate
panel_6 = Panel("30")
panel_7 = Panel("0")
expression_5 = Expression(value=panel_6, upper=panel_7, lower=panel_6, Expression="Abs(upper-value) - Abs(lower-value)")

# ----
ghpython_script = GhPythonScript(input=judgeblocks.GreenRatio, upper=panel_6, lower=panel_7)  # -> out, output
# ---------- ghpython_script: Python ----------
__author__ = "tianf"
__version__ = "2021.12.15"

if lower < input <= upper:
    output = abs(upper-input) - abs(lower-input)
elif upper < input:
    output = abs(upper-input) + abs(lower-input)
elif lower >= input:
    output = abs(upper-input)-abs(lower-input)
# ---------- end ghpython_script ----------

# ---- group: Greening Rate (continued)
wlc_greening_rate = Number(ghpython_script.output)

# ----
panel_8 = Panel(wlc_greening_rate)

# ---- group: Plot Ratio
panel_9 = Panel("1.7")
panel_10 = Panel("1.5")
expression_6 = Expression(value=Slider(1.38, range=0..2), upper=panel_9, lower=panel_10, Expression="Abs(upper-value) - Abs(lower-value)")  # disabled

# ----
ghpython_script_2 = GhPythonScript(input=judgeblocks.PlotRatio, upper=panel_9, lower=panel_10)  # -> out, output; same code as ghpython_script

# ---- group: Plot Ratio (continued)
wlc_plot_ratio = Number(ghpython_script_2.output)

# ----
panel_11 = Panel(wlc_plot_ratio)
wallacei_x_2 = WallaceiX(
    Genes=[wlc_split_degree, wlc_split_direction, wlc_floors_num],
    Objectives=[wlc_plot_ratio, wlc_building_density, wlc_greening_rate, wlc_roomunit_count, wlc_sunlight_hour],
    Data=[judgeblocks.PlotRatio, judgeblocks.BuildingDensity, judgeblocks.GreenRatio, judgeblocks.RoomNum, directsunhours.results],
    Phenotype=merge,
    popGen="-1,-1",
    total="0",
    wlcDone=False)  # -> WallaceiGenomes, FitnessValues, Data, Phenotypes
