# Grasshopper definition 实验.gh (Grasshopper 1.0.7)

line = Line(Line((-11.28125683, -6.093525586, 0), (12.26939611, 10.48525574, 0)))
line_2 = Line(Line((-7.054216557, 9.716702961, 0), (4.858351481, -6.36800872, 0)))
curve = Curve(<curve referenced from the Rhino model>)
line_line = LineLine(LineA=line_2, LineB=line)
顺时针旋转 = CSharpScript(curve=curve, line2=line)  # -> out, A; inputs curve: Curve, line2: Line
# ---------- 顺时针旋转: C# ----------
    var midpoint = curve.PointAtNormalizedLength(0.5);
    var xform = Transform.Rotation(-Math.PI / 2, midpoint);
    var rotatedCurve = curve.DuplicateCurve();
    rotatedCurve.Transform(xform);
    
    A = rotatedCurve;
# ---------- end 顺时针旋转 ----------
转换curv为line = CSharpScript(curve=curve, line2=line)  # -> out, A; inputs curve: Curve, line2: Line
# ---------- 转换curv为line: C# ----------
    Line line = new Line(curve.PointAtStart, curve.PointAtEnd);
    A = line;
# ---------- end 转换curv为line ----------
c_script = CSharpScript(line1=line_2, line2=line)  # -> out, A; inputs line1: Line, line2: Line
# ---------- c_script: C# ----------
    var xAxis = line1.Direction;
    var yAxis = line2.Direction;
    var origin = line1.From;

    var zAxis = Plane.WorldXY.ZAxis;
    var plane = new Rhino.Geometry.Plane(origin, xAxis, yAxis);
    A = plane;
# ---------- end c_script ----------
plane = Plane(c_script.A)
end_points = EndPoints(Curve=顺时针旋转.A)  # -> Start, End
end_points_2 = EndPoints(Curve=curve)  # -> Start, End
box_2pt = Box2Pt(Plane=PlaneXY(0, 0, 0))
domain_box = DomainBox(Base=c_script.A, X=" 0 to 2", Y=" 0 to -2", Z=Domain(0, 0.25))
point = Point(end_points_2.End)
point_2 = Point(end_points.End)
