# Grasshopper definition 角度.gh (Grasshopper 1.0.7)

curve = Curve(<curve referenced from the Rhino model>)
curve_2 = Curve(<curve referenced from the Rhino model>)
point = Point(<point referenced from the Rhino model>)
point_2 = Point(<point referenced from the Rhino model>)
flip_curve = FlipCurve(Curve=curve_2)  # -> Curve, Flag
curve_3 = Curve(<curve referenced from the Rhino model>)
point_3 = Point(<point referenced from the Rhino model>)
point_4 = Point(<point referenced from the Rhino model>)
curve_4 = Curve(<curve referenced from the Rhino model>)
c_script = CSharpScript(curve1=curve, pt=point)  # -> out, A; inputs curve1: Curve, curve2: Curve, pt: Point3d
# ---------- c_script: C# ----------
    //    var intersection = Rhino.Geometry.Intersect.Intersection.CurveCurve(curve1, curve2, RhinoMath.ZeroTolerance, RhinoMath.ZeroTolerance);
    //    var intersectionPt = intersection[0].PointA;
    //    A = CalculateAngleBetweenCurvesAtIntersection(curve1, curve2, intersectionPt);


    //    // 获取曲线上的一个点及其切线向量
    //    double t = 0.5; // 曲线参数
    //    Vector3d tangent;
    //    tangent = curve1.TangentAt(t);
    //    A = Vector3d.VectorAngle(tangent, Vector3d.YAxis);

    A = CalculateAngleBetweenCurvesWithAxis(curve1, Vector3d.YAxis, pt);
# ---------- c_script: C# additional code ----------
  public static double? CalculateAngleBetweenCurvesWithAxis(Curve curve1, Vector3d axis, Point3d intersection)
  {
    // 获取曲线上的一个点及其切线向量
    double t = 0.5; // 曲线参数
    Vector3d tangent;
    tangent = curve1.TangentAt(t);
    double angleRadians = Vector3d.VectorAngle(tangent, axis);

    // Convert the angle from radians to degrees and return it
    double angleDegrees = Rhino.RhinoMath.ToDegrees(angleRadians);
    return angleDegrees;
  }



  public static double? CalculateAngleBetweenCurvesAtIntersection(Curve curve1, Curve curve2, Point3d intersection)
  {
    double t1;
    double t2;
    // Find the parameter on each curve that is closest to the intersection point
    curve1.ClosestPoint(intersection, out t1);
    curve2.ClosestPoint(intersection, out t2);

    // Get the tangent vectors at these points
    Vector3d tangent1 = curve1.TangentAt(t1);
    Vector3d tangent2 = curve2.TangentAt(t2);

    // Calculate the angle between these vectors
    double angleRadians = Vector3d.VectorAngle(tangent1, tangent2);

    // Convert the angle from radians to degrees and return it
    double angleDegrees = Rhino.RhinoMath.ToDegrees(angleRadians);
    return angleDegrees;
  }
# ---------- end c_script ----------
curve_5 = Curve(<curve referenced from the Rhino model>)
curve_6 = Curve(<curve referenced from the Rhino model>)
c_script_2 = CSharpScript(baseCurve=curve_5)  # -> out, A; inputs baseCurve: Curve
# ---------- c_script_2: C# ----------
    var baseCurves = new List<Curve>();
    Curve[] segments = baseCurve.DuplicateSegments();
    if (segments != null && segments.Length > 0)
    {
      baseCurves.AddRange(segments);
    }
# ---------- c_script_2: C# additional code ----------
  public static Curve FindTheShortestCurve(List<Curve> curvesList)
  {
    double shortestLength = double.MaxValue;
    Curve shortestCurve = null;

    foreach (Curve curve in curvesList)
    {
      double length = curve.GetLength();

      if (length < shortestLength)
      {
        shortestLength = length;
        shortestCurve = curve;
      }
    }
    return shortestCurve;
  }
# ---------- end c_script_2 ----------
c_script_3 = CSharpScript(landCurve=curve_6)  # -> out, A; inputs landCurve: Curve
# ---------- c_script_3: C# ----------
    var landCurves = new List<Curve>();
    Curve[] segments = landCurve.DuplicateSegments();
    if (segments != null && segments.Length > 0)
    {
      landCurves.AddRange(segments);
    }
    A = landCurves;
# ---------- end c_script_3 ----------
c_script_4 = CSharpScript(x=curve_3, y=curve_4)  # -> out, A; inputs x: Curve, y: Curve
# ---------- c_script_4: C# ----------
    A = CheckOverlap(x, y);
# ---------- c_script_4: C# additional code ----------
  public bool CheckOverlap(Curve curve1, Curve curve2)
  {
    // 设置相交计算的容忍度
    double tolerance = RhinoDoc.ActiveDoc.ModelAbsoluteTolerance;

    // 计算曲线的交集
    Rhino.Geometry.Intersect.CurveIntersections intersections = Rhino.Geometry.Intersect.Intersection.CurveCurve(curve1, curve2, tolerance, tolerance);

    // 检查交集是否存在
    if (intersections != null && intersections.Count > 0)
    {
      foreach (Rhino.Geometry.Intersect.IntersectionEvent ie in intersections)
      {
        // 如果交集的类型是区间重叠，那么两条线部分重合
        if (ie.IsOverlap)
        {
          RhinoApp.WriteLine("The lines overlap");
          return true;
        }
        else
        {
          return false;
        }
      }
    }
    return false;
  }
# ---------- end c_script_4 ----------
c_script_5 = CSharpScript(x=point_3, y=point_4)  # -> out, A; inputs x: Point3d, y: Point3d
# ---------- c_script_5: C# ----------
    A = x.Equals(y);
# ---------- end c_script_5 ----------
panel = Panel(c_script.A)
cherry_picker = CherryPicker(c_script_3.A, ListIndex=1)
panel_2 = Panel(c_script_4.A)
point_on_curve = PointOnCurve(cherry_picker, parameter=1)
